# Grasshopper definition assignment-01.gh (Grasshopper 1.0.9)

# Assignment-01: Bauhaus
number_slider = Slider(3, range=3..6)
layout = Python3Script(
    tower_count=number_slider,
    spacing_mult=Slider(1.8, range=1.1..3),
    bridge_z=Slider(70, range=30..100),
    asymmetry=Slider(0.6, range=0..0.8),
    contrast=Slider(0, range=0..1))  # -> out, points, angles, widths, depths, heights, radius; inputs tower_count: Int32
# ---------- layout: Python ----------
"""
Assignment 1 -- Munich Bauhaus Stonehenge -- 01 LAYOUT
A ring of stepped towers (Marina Bay Sands) carrying sloped lintels on their
tops (Stonehenge trilithons), a ring of standing stones in between, a round
plinth, and a gate through the front tower.

Canvas (one Python 3 component per file, each output -> its own Custom Preview):

    sliders -> 01 Layout -+-> 02 Towers -> Custom Preview
                          |       +-- tops --> 03 Bridge + SkyPark -> Custom Preview
                          +-> 04 Stones -> Custom Preview
                          +-> 05 Plinth -> Custom Preview

This component
    Inputs  (Item Access): tower_count (int), spacing_mult, bridge_z, asymmetry,
                           contrast
    Outputs: out, points, angles, widths, depths, heights, radius

Relationships
    tower_count  -> footprints cycle W_FACTORS (3) against D_FACTORS (4), so the
                    rhythm of widths and depths only repeats after 12 towers.
    contrast     -> EQUAL VOLUME, softened: height = k * (VOLUME / footprint)^contrast.
                    1 is strict equal volume (a slim tower is a tall one);
                    0.5 softens the differences; 0 makes all towers equal.
    bridge_z     -> k is chosen so the shortest tower is exactly bridge_z tall:
                    it sets the lowest lintel and scales every tower.
    spacing_mult -> RING: the gap between towers is spacing_mult x the widest
                    tower, which sets the ring radius; towers never collide.
                    Tower 0 stands at the front (-Y).
    asymmetry    -> DYNAMIC BALANCE (0..0.8): the gaps between towers grow
                    steadily around the ring, from (1 - asymmetry) to
                    (1 + asymmetry) x the average gap. 0 is a regular ring; higher
                    values cluster the towers on one side and open the other.
                    The ring radius grows so the TIGHTEST gap still equals
                    spacing_mult x the widest tower.
"""

import math
import Rhino.Geometry as rg

BASE_W, BASE_D = 40.0, 30.0
W_FACTORS = [1.00, 1.35, 0.70]
D_FACTORS = [1.00, 0.70, 1.25, 0.90]
VOLUME = 60000.0

n = max(3, int(tower_count or 3))
spacing_mult = max(1.05, spacing_mult or 2.5)
bridge_z = max(10.0, bridge_z or 60.0)
asymmetry = min(0.8, max(0.0, asymmetry or 0.0))
contrast = 1.0 if contrast is None else min(1.0, max(0.0, contrast))

# EQUAL VOLUME, shortest tower = bridge_z
widths = [BASE_W * W_FACTORS[i % 3] for i in range(n)]
depths = [BASE_D * D_FACTORS[i % 4] for i in range(n)]
raw = [(VOLUME / (w * d)) ** contrast for w, d in zip(widths, depths)]
k = bridge_z / min(raw)
heights = [k * h for h in raw]

# RING with DYNAMIC BALANCE: gap i (tower i -> i+1) has weight 1 - a ... 1 + a
weights = [1.0 + asymmetry * (2.0 * i / (n - 1) - 1.0) for i in range(n)]
gaps = [2.0 * math.pi * wt / n for wt in weights]          # weights sum to n
pitch = spacing_mult * max(widths)
radius = pitch / (2.0 * math.sin(min(gaps) / 2.0)) + max(depths) / 2.0
angles = [-math.pi / 2.0 + sum(gaps[:i]) for i in range(n)]
points = [rg.Point3d(radius * math.cos(a), radius * math.sin(a), 0) for a in angles]

out = "towers: {}  ring radius: {:.1f}  k: {:.2f}\nheights: {}".format(
    n, radius, k, ", ".join("{:.1f}".format(h) for h in heights))
# ---------- end layout ----------
plinth = Python3Script(widths=layout.widths, depths=layout.depths, radius=layout.radius)  # -> out, geometry, colors; inputs widths: list, depths: list
# ---------- plinth: Python ----------
"""
Assignment 1 -- Munich Bauhaus Stonehenge -- 05 PLINTH

Inputs
    List Access: widths, depths  <- 01 Layout
    Item Access: radius          <- 01 Layout
Outputs: geometry, colors   (geometry -> Custom Preview G, colors -> M)

Relationships
    (radius) -> PLINTH radius = ring radius + half the largest tower diagonal
                + PLINTH_MARGIN, so the base always holds the whole ring.
"""

import importlib
import math
import Rhino.Geometry as rg
from System.Drawing import Color
import cdf.geometry_basics as gb
importlib.reload(gb)

PLINTH_THICK, PLINTH_MARGIN = 2.0, 15.0

plinth_radius = radius + max(math.hypot(w, d) for w, d in zip(widths, depths)) / 2.0 + PLINTH_MARGIN
geometry = gb.create_cylinder(rg.Point3d(0, 0, -PLINTH_THICK), plinth_radius, PLINTH_THICK)
colors = Color.FromArgb(235, 235, 230)
# ---------- end plinth ----------
panel = Panel(layout.out)
preview = CustomPreview(Geometry=plinth.geometry, Material=plinth.colors)
panel_2 = Panel(plinth.out)
towers = Python3Script(
    tower_count=number_slider,
    points=layout.points,
    angles=layout.angles,
    widths=layout.widths,
    depths=layout.depths,
    heights=layout.heights,
    blockiness=Slider(4, range=1..6),
    lean=Slider(0.6, range=0..1),
    arch_ratio=Slider(0.6, range=0..0.9))  # -> out, geometry, colors, tops, tower_colors; inputs tower_count: Int32, points: list of Point3d, angles: list of Double, widths: list, depths: list, heights: list, blockiness: Int32
# ---------- towers: Python ----------
"""
Assignment 1 -- Munich Bauhaus Stonehenge -- 02 TOWERS (with the gate)

Inputs
    List Access: points (Point3d), angles, widths, depths, heights  <- 01 Layout
    Item Access: blockiness (int), lean, arch_ratio                 <- sliders
Outputs: out, geometry, colors, tops, tower_colors
    (geometry -> Custom Preview G, colors -> M, tops -> 03 Bridge,
     tower_colors -> 04 Stones)

Relationships
    (heights)  -> FORM + COLOUR by height rank (Kandinsky): the tallest third
                  are yellow triangles, the middle third red squares, the lowest
                  third blue circles.
    blockiness -> MODULAR BLOCKS: the tallest tower gets `blockiness` blocks, the
                  others get blocks in proportion to their height, so every block
                  in the composition is roughly the same height.
    lean       -> LEAN (0..1): 0 steps every tower in evenly; at 1/3 the face
                  toward the court is upright and all setbacks face outward;
                  above that each block overhangs the one below toward the court,
                  so the towers lean in like Marina Bay Sands. At 1 the top block
                  juts out 0.4 x the tower depth past the base.
    (lean)     -> tops: the centre of each top block, which moves with lean, so
                  the bridge always rests on the real tops.
    arch_ratio -> GATE: arch radius = arch_ratio x half the front tower's width,
                  so the half-round gate always fits inside the tower it cuts.
"""

import importlib
import math
import Rhino.Geometry as rg
from System.Drawing import Color
import cdf.geometry_basics as gb
importlib.reload(gb)

FORMS = [("triangle", Color.FromArgb(240, 190, 0)),   # tallest third: yellow
         ("box", Color.FromArgb(200, 30, 30)),        # middle third: red
         ("cylinder", Color.FromArgb(20, 60, 160))]   # lowest third: blue

n = len(points)
blockiness = max(1, int(blockiness or 3))
lean = min(1.0, max(0.0, lean or 0.0))
LEAN_MAX = 3.0      # lean 1 -> align -3: blocks slide past the base toward the court
TOP_SCALE = 0.6     # create_stepped_tower's default top block scale
arch_ratio = 0.6 if arch_ratio is None else min(0.9, max(0.0, arch_ratio))

# FORM + COLOUR by height rank
rank = sorted(range(n), key=lambda i: -heights[i])
forms = [FORMS[rank.index(i) * 3 // n] for i in range(n)]

# MODULAR BLOCKS
tiers = [max(1, round(blockiness * h / max(heights))) for h in heights]

# TOWERS with LEAN: negative align slides upper blocks toward the court
# (local +Y points outward, away from the ring centre)
align = -LEAN_MAX * lean
towers, tops = [], []
for p, a, w, d, h, t, (shape, _) in zip(points, angles, widths, depths, heights, tiers, forms):
    blocks = gb.create_stepped_tower(p, w, d, h, tiers=t, angle=a - math.pi / 2.0,
                                     align=align, shape=shape)
    towers.append(gb.boolean_union(blocks))
    shift = align * (1.0 - (TOP_SCALE if t > 1 else 1.0)) * d / 2.0   # same rule as the top block
    tops.append(rg.Point3d(p.X + shift * math.cos(a), p.Y + shift * math.sin(a), h))

# GATE: half-round arch along Y through the front tower (tower 0)
arch_radius = arch_ratio * widths[0] / 2.0
if arch_radius > 0:
    reach = 2.0 * abs(points[0].Y) + max(depths)
    arch_void = gb.create_cylinder(rg.Point3d(0, -reach, 0), arch_radius, 2.0 * reach, rg.Vector3d.YAxis)
    cut = []
    for tower in towers:
        pieces = []
        for part in tower:
            result = gb.boolean_difference(part, arch_void)
            pieces += list(result) if result else [part]
        cut.append(pieces)
    towers = cut

tower_colors = [color for _, color in forms]   # one per tower, for 04 Stones
geometry, colors = [], []
for tower, (_, color) in zip(towers, forms):
    geometry += tower
    colors += [color] * len(tower)

out = "forms:  {}\nblocks: {}\ngate radius: {:.1f}".format(
    ", ".join(s for s, _ in forms), ", ".join(str(t) for t in tiers), arch_radius)
# ---------- end towers ----------
panel_3 = Panel(towers.out)
preview_2 = CustomPreview(Geometry=towers.geometry, Material=towers.colors)
bridge = Python3Script(angles=layout.angles, radius=layout.radius, tops=towers.tops, overhang=Slider(80, range=0..100))  # -> out, geometry, colors; inputs angles: list, tops: list of Point3d
# ---------- bridge: Python ----------
"""
Assignment 1 -- Munich Bauhaus Stonehenge -- 03 BRIDGE + SKYPARK

Inputs
    List Access: tops (Point3d)   <- 02 Towers
                 angles           <- 01 Layout
    Item Access: radius           <- 01 Layout
                 overhang         <- slider (0..100 m)
Outputs: out, geometry, colors   (geometry -> Custom Preview G, colors -> M)

Relationships
    (tops)    -> TRILITHONS: lintel i rests on the top blocks of towers i and
                 i+1, so it slopes by their height difference and follows the
                 towers when they lean. Lintels are black. Where a lintel meets
                 a SkyPark tower it rests on the deck instead, never through it.
    (tops)    -> SKYPARK (Marina Bay Sands): the lintel between the TALLEST PAIR
                 OF NEIGHBOURS (highest lower top) becomes a level white deck,
                 laid on the lower of the two tops; the taller tower rises
                 through it as a crown.
    (angles)  -> CANTILEVER SIDE: the deck cantilevers from the end nearer the
                 widest gap in the ring (the opening made by `asymmetry`), so the
                 MBS cantilever points at the open side of the composition.
    overhang  -> CANTILEVER: that end reaches `overhang` metres past its tower;
                 the other end stops SKYPARK_MARGIN past its tower.
"""

import importlib
import math
import Rhino.Geometry as rg
from System.Drawing import Color
import cdf.geometry_basics as gb
importlib.reload(gb)

LINTEL_WIDTH, LINTEL_THICK = 10.0, 6.0
SKYPARK_W, SKYPARK_THICK, SKYPARK_MARGIN = 18.0, 5.0, 8.0
BLACK, WHITE = Color.FromArgb(30, 30, 30), Color.FromArgb(235, 235, 230)

n = len(tops)
overhang = 40.0 if overhang is None else max(0.0, overhang)

# SKYPARK pair: neighbours i, i+1 whose LOWER top is highest
sky = max(range(n), key=lambda i: min(tops[i].Z, tops[(i + 1) % n].Z))

# CANTILEVER SIDE: the middle of the widest gap between neighbouring towers
gaps = [(angles[(i + 1) % n] - angles[i]) % (2.0 * math.pi) for i in range(n)]
w = max(range(n), key=lambda i: gaps[i])
open_a = angles[w] + gaps[w] / 2.0

t0, t1 = tops[sky], tops[(sky + 1) % n]
deck_z = min(t0.Z, t1.Z)
p0, p1 = rg.Point3d(t0.X, t0.Y, deck_z), rg.Point3d(t1.X, t1.Y, deck_z)
open_pt = rg.Point3d(radius * math.cos(open_a), radius * math.sin(open_a), deck_z)
near, far = (p0, p1) if p0.DistanceTo(open_pt) < p1.DistanceTo(open_pt) else (p1, p0)

along = near - far
along.Unitize()
geometry = [gb.create_beam(far - along * SKYPARK_MARGIN, near + along * overhang,
                           SKYPARK_W, SKYPARK_THICK)]
colors = [WHITE]


def seat(k):
    """Where a lintel sits on tower k: its top, or the deck surface if higher."""
    p = tops[k]
    if k in (sky, (sky + 1) % n):
        return rg.Point3d(p.X, p.Y, max(p.Z, deck_z + SKYPARK_THICK))
    return p


for i in range(n):  # TRILITHONS, except the pair that carries the SkyPark
    if i != sky:
        geometry.append(gb.create_beam(seat(i), seat((i + 1) % n), LINTEL_WIDTH, LINTEL_THICK))
        colors.append(BLACK)

out = "skypark on towers {} and {}  deck z: {:.1f}  crown: {:.1f}  overhang: {:.1f}".format(
    sky, (sky + 1) % n, deck_z, abs(t0.Z - t1.Z), overhang)
# ---------- end bridge ----------
stones = Python3Script(
    tower_colors=towers.tower_colors,
    angles=layout.angles,
    widths=layout.widths,
    depths=layout.depths,
    heights=layout.heights,
    radius=layout.radius,
    stones=Slider(0, range=0..6),
    ruin=Slider(0, range=0..1))  # -> out, geometry, colors; inputs tower_colors: list, angles: list of Double, widths: list, depths: list, heights: list, stones: Int32
# ---------- stones: Python ----------
"""
Assignment 1 -- Munich Bauhaus Stonehenge -- 04 STONES

Inputs
    List Access: angles, widths, depths, heights  <- 01 Layout
                 tower_colors (Color)             <- 02 Towers
    Item Access: radius                           <- 01 Layout
                 stones (int), ruin               <- sliders
Outputs: out, geometry, colors   (geometry -> Custom Preview G, colors -> M)

Relationships
    stones    -> STONE RING: up to `stones` standing stones fill each gap between
                 two towers, evenly spaced on the same circle; fewer if the gap
                 is too narrow (spacing >= STONE_GAP x stone width).
    (heights) -> stone height = STONE_RATIO x the lower of the two towers it
                 stands between, so the small ring echoes the big one; width,
                 depth and lintel thickness are fixed fractions of that height.
    (stones)  -> SMALL TRILITHONS: every pair of neighbouring stones carries a
                 flat lintel.
    ruin      -> RUIN: that fraction of stones (0..1, fixed SEED) has fallen
                 outward and lies on the plinth; its lintel is gone.
    (tower_colors) -> COLOUR: each stone takes the colour of the nearer of the
                 two towers it stands between: each gap switches colour halfway,
                 so the Kandinsky rule of the towers carries into the small
                 ring; lintels stay black like the bridge.
"""

import importlib
import math
import random
import Rhino.Geometry as rg
from System.Drawing import Color
import cdf.geometry_basics as gb
importlib.reload(gb)

STONE_RATIO, STONE_GAP, SEED = 0.25, 1.6, 7
STONE_W, STONE_D, STONE_LINTEL = 0.45, 0.25, 0.15   # x stone height (Stonehenge proportions)
BLACK = Color.FromArgb(30, 30, 30)

n = len(angles)
stones = 4 if stones is None else max(0, int(stones))
ruin = min(1.0, max(0.0, ruin or 0.0))


def on_ring(a, r, z=0.0):
    return rg.Point3d(r * math.cos(a), r * math.sin(a), z)


rng = random.Random(SEED)   # decides which stones fall
geometry, colors = [], []
for i in range(n):
    j = (i + 1) % n
    stone_h = STONE_RATIO * min(heights[i], heights[j])
    sw, sd = STONE_W * stone_h, STONE_D * stone_h
    clear_i = (math.hypot(widths[i], depths[i]) / 2.0 + sw) / radius   # keep clear of the towers
    clear_j = (math.hypot(widths[j], depths[j]) / 2.0 + sw) / radius
    gap = (angles[j] - angles[i]) % (2.0 * math.pi)   # gaps differ with asymmetry
    a0, a1 = angles[i] + clear_i, angles[i] + gap - clear_j
    if a1 <= a0:
        continue
    count = min(stones, int((a1 - a0) * radius / (STONE_GAP * sw)) + 1)
    ring = [a0 + (a1 - a0) * (s + 0.5) / count for s in range(count)]
    fallen = [rng.random() < ruin for _ in ring]
    for a, down in zip(ring, fallen):
        colors.append(tower_colors[i] if a - angles[i] < gap / 2.0 else tower_colors[j])  # nearer tower
        if down:  # lying on its side, toppled outward
            geometry.append(gb.create_box(on_ring(a, radius + stone_h / 2.0), sw, stone_h, sd, a - math.pi / 2.0))
        else:
            geometry.append(gb.create_box(on_ring(a, radius), sw, sd, stone_h, a - math.pi / 2.0))
    for s in range(0, count - 1, 2):  # lintel on each standing pair
        if fallen[s] or fallen[s + 1]:
            continue
        p0, p1 = on_ring(ring[s], radius, stone_h), on_ring(ring[s + 1], radius, stone_h)
        along = p1 - p0
        along.Unitize()
        geometry.append(gb.create_beam(p0 - along * sw / 2.0, p1 + along * sw / 2.0, sd, STONE_LINTEL * stone_h))
        colors.append(BLACK)

out = "stone parts: {}".format(len(geometry))
# ---------- end stones ----------
panel_4 = Panel(bridge.out)
panel_5 = Panel(stones.out)
preview_3 = CustomPreview(Geometry=bridge.geometry, Material=bridge.colors)
preview_4 = CustomPreview(Geometry=stones.geometry, Material=stones.colors)
