# Grasshopper definition geometry_basics.ghx (Grasshopper 1.0.8)

r = Slider(4, range=1..10)
pt = Point(Point(0.1412500229, -1.081941034, 0))

# ---- group: Example: Build a Parametric Cone
pt_2 = Point(Point(-0.4439523925, 0.05137995213, 0))
cone = Python3Script(pt=pt_2, h=Slider(5, range=1..10), r=Slider(4, range=1..10))  # -> out, my_cone; inputs pt: Point3d
# ---------- cone: Python ----------
# import function
from cdf import create_cone

# call function
my_cone = create_cone(base_point=pt, height=h, radius=r)
# ---------- end cone ----------

# ---- group: Reload after Updating Code
# NOTES:
# 
# - Use Python 3 Script blocks for your functions.
# - Import your functions and classes as: from cdf import my_function, My_class
# - Don't forget to add and name your INPUT and OUTPUT parameters that match your functions correctly. If you zoom in to the Python component you will see the + sign to add and - to remove them.
# - You need to attach the accurate components to your INPUT parameters: sliders for integers or floats, toggles or buttons for booleans, text for strings, Rhino geometries etc. etc.
# - If an INPUT is  a list, you need to right-click the parameter to set it as LIST access. Sometimes you need to also set the type of the INPUT by clicking TYPE HINT and selecting the correct input type.
# - If you want to hide an object, right-click component and uncheck Preview. To visualize again, check Preview.
# - If you get errors, READ THEM! They often tell what's wrong in a simple language. If not, copy-paste to CoPilot and don't be afraid to play around!
# 
# For more Grasshopper Help, go to:
# https://developer.rhino3d.com/guides/scripting/scripting-component/#script-inputs-and-outputs
button = Button()
reload = Python3Script(reload=button)  # -> out
# ---------- reload: Python ----------
if reload:
    from compas_rhino import unload_modules
    unload_modules("cdf")
# ---------- end reload ----------

# ---- group: TODO: Build a Parametric Sphere
sphere = Python3Script(pt=pt, r=r)  # -> out, a; inputs pt: Point3d
# ---------- sphere: Python ----------
from cdf import create_sphere

a = create_sphere(pt, r)
# ---------- end sphere ----------

# ---- group: TODO: Make Transformations
transformation = Python3Script(my_sphere=sphere.a, distance=Slider(10, range=1..10), count=Slider(1, range=1..10))  # -> out, my_spheres; inputs my_sphere: Brep
# ---------- transformation: Python ----------
from cdf import copy_brep_along_z

my_spheres = copy_brep_along_z(my_sphere, distance, count)
# ---------- end transformation ----------

# ---- group: TODO: Make a Boolean Difference
boolean = Python3Script(my_cone=cone.my_cone, my_sphere=sphere.a)  # -> out, result_geometry; inputs my_cone: Brep, my_sphere: Brep
# ---------- boolean: Python ----------
from cdf import boolean_difference

result_geometry = boolean_difference(my_cone, my_sphere)
# ---------- end boolean ----------

# ---- group: Visualize
preview = CustomPreview(Geometry=sphere.a, Material=ColourSwatch(SwatchColor=RGB(255, 86, 88)))

preview_2 = CustomPreview(Geometry=cone.my_cone, Material=ColourSwatch(SwatchColor=RGB(60, 230, 88)))

preview_3 = CustomPreview(Geometry=boolean.result_geometry, Material=ColourSwatch(SwatchColor=RGB(255, 86, 255)))

preview_4 = CustomPreview(Geometry=transformation.my_spheres, Material=ColourSwatch(SwatchColor=RGB(255, 255, 96)))
